% Simulink data dictionary parameters.sldd

Ixx = 0.0086
Iyy = 0.0086
a1 = -1
a2 = 0.004349302
a3 = 1
a4 = 0.004349302
a5 = 0
b1 = 26.16279
b2 = 26.16279
b3 = 13.0814
g = 9.81
kd_Z = 10
kf = 3.13e-5
ki_Z = 0
km = 9.0e-7
kp_Phi = 2.9996
kp_Theta = 3.0239
kp_Z = 30
l = 0.225
m = 0.4794
omega_max = 8482300
kp_Psi = 3.9
ki_Psi = 0
ki_Phi = 0.17
kd_Phi = 0.87
ki_Theta = 0.17
kd_Theta = 0.87
kd_X = 5.7
ki_X = 0
kp_X = 19.5
kp_Y = 19.5
kd_Y = 5.7
ki_Y = 0
kd_Psi = 2.57

quadrotorXY_fis = struct(
  name="quadrotorXY_fis",
  type="mamdani",
  andMethod="min",
  orMethod="max",
  defuzzMethod="centroid",
  impMethod="min",
  aggMethod="max",
  input=[struct(
    name="error_position",
    range=[-1 1],
    mf=[struct(name="NLx", type="gaussmf", params=[0.15 -1.004]), struct(name="NMx", type="gaussmf", params=[0.15 -0.6667]), struct(name="NSx", type="gaussmf", params=[0.15 -0.3334]), struct(name="Zx", type="gaussmf", params=[0.15 0]), struct(name="PSx", type="gaussmf", params=[0.15 0.3334]), struct(name="PMx", type="gaussmf", params=[0.15 0.6667]), struct(name="PLx", type="gaussmf", params=[0.15 1])]), struct(
    name="error_rate",
    range=[-1 1],
    mf=[struct(name="NMy", type="gaussmf", params=[0.15 -0.6667]), struct(name="Zy", type="gaussmf", params=[0.15 0]), struct(name="PMy", type="gaussmf", params=[0.15 0.6667]), struct(name="NLy", type="gaussmf", params=[0.15 -1]), struct(name="NSy", type="gaussmf", params=[0.15 -0.3334]), struct(name="PSy", type="gaussmf", params=[0.15 0.3334]), struct(name="PLy", type="gaussmf", params=[0.15 1])])],
  output=struct(
    name="output_angle",
    range=[-1 1],
    mf=[struct(name="NL", type="trimf", params=[-1.3333 -1 -0.6667]), struct(name="Z", type="trimf", params=[-0.3333 0 0.3333]), struct(name="PM", type="trimf", params=[0.3333 0.6667 1]), struct(name="NM", type="trimf", params=[-1 -0.6667 -0.3333]), struct(name="NS", type="trimf", params=[-0.6667 -0.3333 0]), struct(name="PS", type="trimf", params=[0 0.3333 0.6667]), struct(name="PL", type="trimf", params=[0.6667 1 1.3333])]),
  rule=[struct(antecedent=[1 4], consequent=1, weight=1, connection=1), struct(antecedent=[1 1], consequent=1, weight=1, connection=1), struct(antecedent=[1 5], consequent=1, weight=1, connection=1), struct(antecedent=[1 2], consequent=1, weight=1, connection=1), struct(antecedent=[1 6], consequent=4, weight=1, connection=1), struct(antecedent=[1 3], consequent=5, weight=1, connection=1), struct(antecedent=[1 7], consequent=2, weight=1, connection=1), struct(antecedent=[2 4], consequent=1, weight=1, connection=1), struct(antecedent=[2 1], consequent=1, weight=1, connection=1), struct(antecedent=[2 5], consequent=1, weight=1, connection=1), struct(antecedent=[2 2], consequent=4, weight=1, connection=1), struct(antecedent=[2 6], consequent=5, weight=1, connection=1), struct(antecedent=[2 3], consequent=2, weight=1, connection=1), struct(antecedent=[2 7], consequent=6, weight=1, connection=1), struct(antecedent=[3 4], consequent=1, weight=1, connection=1), struct(antecedent=[3 1], consequent=1, weight=1, connection=1), struct(antecedent=[3 5], consequent=4, weight=1, connection=1), struct(antecedent=[3 2], consequent=5, weight=1, connection=1), struct(antecedent=[3 6], consequent=2, weight=1, connection=1), struct(antecedent=[3 3], consequent=6, weight=1, connection=1), struct(antecedent=[3 7], consequent=3, weight=1, connection=1), struct(antecedent=[4 4], consequent=1, weight=1, connection=1), struct(antecedent=[4 1], consequent=4, weight=1, connection=1), struct(antecedent=[4 5], consequent=5, weight=1, connection=1), struct(antecedent=[4 2], consequent=2, weight=1, connection=1), struct(antecedent=[4 6], consequent=6, weight=1, connection=1), struct(antecedent=[4 3], consequent=3, weight=1, connection=1), struct(antecedent=[4 7], consequent=7, weight=1, connection=1), struct(antecedent=[5 4], consequent=4, weight=1, connection=1), struct(antecedent=[5 1], consequent=5, weight=1, connection=1), struct(antecedent=[5 5], consequent=2, weight=1, connection=1), struct(antecedent=[5 2], consequent=6, weight=1, connection=1), struct(antecedent=[5 6], consequent=3, weight=1, connection=1), struct(antecedent=[5 3], consequent=7, weight=1, connection=1), struct(antecedent=[5 7], consequent=3, weight=1, connection=1), struct(antecedent=[6 4], consequent=5, weight=1, connection=1), struct(antecedent=[6 1], consequent=2, weight=1, connection=1), struct(antecedent=[6 5], consequent=6, weight=1, connection=1), struct(antecedent=[6 2], consequent=3, weight=1, connection=1), struct(antecedent=[6 6], consequent=7, weight=1, connection=1)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])